# Dynamo graph Delete Dimensions.dyn (Dynamo 2.3.0.5885)

element_types = ElementTypes("DimensionType")
all_elements_of_type = ElementsOfType(element_type=element_types)
name = Element.Name(element=all_elements_of_type)
code_block = CodeBlock { "do not use "; }
contains = String.Contains(str=name, searchFor=code_block)
filterByBoolMask = List.FilterByBoolMask(list=all_elements_of_type, mask=contains)
delete = Element.Delete(element=filterByBoolMask.in)
